vi "FSKRxProject.gvi"   [LabVIEW Communications System Design Software 2.0.1]
panel controls:
  "IQ rate": f64 = 400000
  "carrier frequency": f64 = 915000000
  "gain (dB)": f64
  "active antenna": string = "RX2"
  "symbol rate (sym/s)": i64 = 10000
  "adc.m path": path = path "C:\\Users\\Emirhan Garip\\Desktop\\Telecom Proje\\EE3001_FinalProject(NC_YC_EA)\\MATLAB Files"
  "niUSRP Device": "niUSRPClass"
  "HEAR PLUS PRO MAX +": bool
panel indicators:
  "actual IQ rate": f64
  "actual carrier frequency": f64
  "actual gain (dB)": f64
  "Baseband Output": cluster{"t0": f64, "dt": f64, "Y": f64[]}
  "Eye Diagram": cluster{"t0": f64, "dt": f64, "Y": f64[]}[]
  "millisecond timer value": u32
  "Graph": f64[]
  "framesync_2": i16[]
  "son_3": i16[]
  "raw_2": f64[]
  "BER": f64
types:
  "Sound Data Format.gtype" = cluster{"sample rate (S/s)": f64, "number of channels": i32, "bits per sample": i32}
uses:
  NI::Analysis::Conditioning::Unwrap Phase.gvi
  NI::Analysis::Operations::1D Convolution (DBL).gvi
  NI::Analysis::Resampling::Decimate (single shot, DBL).gvi
diagram:
  call "niUSRP Open Rx Session.gvi"(niUSRP Device=$"niUSRP Device", reset=TRUE) -> (error out=w1, session handle out=w2)
  call "niUSRP Configure Signal.gvi"(session handle=w2, IQ rate=$"IQ rate", carrier frequency=$"carrier frequency", gain=$"gain (dB)", error in (no error)=w1, active antenna=$"active antenna") -> (session handle out=w3, coerced IQ rate=w4, coerced carrier frequency=w5, coerced gain=w6, Error Out=w7)
  call "niUSRP Initiate.gvi"(session handle=w3, error in (no error)=w7) -> (session handle out=w8, Error Out=w9)
  w10 = $"adc.m path"
  Path To String(path=w10) -> (string=w11)
  Concatenate Strings(w11, "\\ear_thresholds.txt") -> w12
  # samples/symbol = Decimation Factor
  # Upsampling
  # Pulse Shaping
  while {
    To Double Precision Float(number=$"symbol rate (sym/s)") -> w13
    Divide(x=w4, y=w13) -> w14
    To Long Integer(number=w14) -> w15
    Add(26, 78) -> w16
    Multiply(w16, w14) -> w17
    Multiply(2, w17) -> w18
    To Quad Integer(number=w18) -> w19
    call "niUSRP Fetch Rx Data (CDB Cluster).gvi"(session handle=w8, number of samples=w19, error in (no error)=w9) -> (session handle out=w20, data=w21, Error Out=w22)
    Property Node(instance in=w21) -> ("dt"=w23, "Y"=w24)
    To Long Integer(number=w14) -> w25
    call "MT Generate Filter Coefficients.gvi"(pulse shaping filter="Root Raised Cos", matched samples per symbol=w25, modulation type="FSK") -> (matched filter coefficients=w26)
    # no. samples
    Complex To Polar(r * e^(i*theta)=w24) -> (theta=w27)
    call "Unwrap Phase.gvi"(input phase=w27, phase unit="degree in, radian out"(3)) -> (unwrapped phase=w28)
    call "FIR Filter (DBL).gvi"(x=w28, FIR coefficients=[1, -1]) -> (filtered x=w29)
    call "Median Filter2.gvi"(X=w29, left rank=10) -> (Filtered X=w30)
    call "1D Convolution (DBL).gvi"(x=w30, y=w26) -> (x * y=w31)
    w32 = cluster{"t0": f64, "dt": f64, "Y": f64[]} {all zero or empty}
    Property Node(instance in=w32, "dt"=w23, "Y"=w31) -> (instance out=w33)
    call "PulseAlign(real).gvi"(Input Signal=w33, Receiver Sampling Factor=w15) -> (Aligned Signal=w34)
    Property Node(instance in=w34) -> ("Y"=w35)
    call "Decimate (single shot, DBL).gvi"(input array=w35, decimating factor=w15) -> (decimated array=w36)
    call "Quick Scale 1D.gvi"(X=w36) -> (Y[i]=X[i]/Max|X|=w37)
    $raw_2 <- w37
    $"Baseband Output" <- w33
    To Double Precision Float(number=0) -> w38
    To Double Precision Float(number=w15) -> w39
    call "FrameSync(Real).gvi"(Sampled Input=w37, Receiver Sampling Factor=w39) -> (Aligned Samples=w40)
    Is Greater(x=w40, y=w38) -> w41
    Boolean To Integer(Boolean=w41) -> (0, 1=w42)
    $framesync_2 <- w42
    To Long Integer(number=78) -> w43
    Array Subset(array=w42, index0=0, length0=w43) -> w44
    $son_3 <- w44
    To Double Precision Float(number=w44) -> w45
    Math Node("binary_data"=w45) -> ("final_output"=w46)
    ~~~
    % --- Step 2: Reshape into 3-bit groups (Mx3 matrix) ---
    binary_matrix = reshape(binary_data, 3, [])'; % Transpose to get Mx16

    % --- Step 3: Convert each 16-bit row to decimal (big-endian) ---
    decimal_values = zeros(size(binary_matrix, 1), 1); % Preallocate output

    for i = 1:size(binary_matrix, 1)
        % Get the 3 bits for the current sample (no flipping)
        bits = binary_matrix(i, :);

        % Convert binary to decimal (weights: 2^3 to 2^0)
        dec = sum(bits .* (2.^(2:-1:0)));

        decimal_values(i) = dec;
    end

    % --- Step 4: Output the result ---
    final_output = (decimal_values/5)+1; % For the example, this will be [60]
    ~~~
    $Graph <- w46
    To Double Precision Float(number=$"symbol rate (sym/s)") -> w47
    Build Waveform Node(Y=w31, dt=w23, t0=1904-01-01T00:00:00Z) -> (output waveform=w48)
    call "MT Format Eye Diagram (WDT).gvi"(waveform=w48, symbol rate=w47, eye length=2) -> (eye diagram=w49)
    $"Eye Diagram" <- w49
    String To Path(string=w12) -> (path=w50)
    Open Or Create Or Replace File(file path (use dialog)=w50) -> (error out=w51)
    call "Is Error.gvi"(error in=w51) -> (is error?=w52)
    Not(x=w52) -> w53
    Wait(time to wait=100)
    Path To String(path=w10) -> (string=w54)
    Concatenate Strings(w54, "\\earthresholds.txt") -> w55
    String To Path(string=w55) -> (path=w56)
    # Reading the original bitstream without error
    # Reading the original bitstream without error
    while {
      Open Or Create Or Replace File(file path (use dialog)=w56) -> (error out=w57)
      call "Is Error.gvi"(error in=w57) -> (is error?=w58)
      Not(x=w58) -> w59
      stop if w59
    }
    call "Read from Spreadsheet File (DBL).gvi"(file path=w56) -> (all rows=w60)
    Array Index(array=w60) -> (out0[_, 0]=w61)
    To Double Precision Float(number=w44) -> w62
    Subtract(x=w61, y=w62) -> w63
    Absolute Value(x=w63) -> w64
    Add Array Elements(numeric array=w64) -> (sum=w65)
    Array Size(array=w61) -> (size(s)=w66)
    To Double Precision Float(number=w66) -> w67
    Divide(x=w65, y=w67) -> w68
    $BER <- w68
    stop if w53
  }
  Path To String(path=w10) -> (string=w69)
  Concatenate Strings(w69, "\\chunk.txt") -> w70
  String To Path(string=w70) -> (path=w71)
  # Reading the original bitstream without error
  # Reading the original bitstream without error
  while {
    Open Or Create Or Replace File(file path (use dialog)=w71) -> (error out=w72)
    call "Is Error.gvi"(error in=w72) -> (is error?=w73)
    Not(x=w73) -> w74
    stop if w74
  }
  while {
    call "Read from Spreadsheet File (DBL).gvi"(file path=w71) -> (all rows=w75)
    Array Index(array=w75) -> (out0[_, 0]=w76)
    case ($"HEAR PLUS PRO MAX +") {
      frame False, Default { }
      frame True {
        call "FilterBankDynamicGain_EU.gvi"(characteristics=w46, signal=w76) -> (out=w77)
        Divide(x=w77, y=32768) -> w78
        Build Waveform Node(Y=w78) -> (output waveform=w79)
        Build Array(w79) -> w80
        w81 = "Sound Data Format.gtype" {"sample rate (S/s)"=22050, "number of channels"=1, "bits per sample"=16}
        # Playing the sounds
        call "Sound Output Configure.gvi"(device ID=0, sound format=w81, number of samples/ch=44100) -> (task ID=w82, error out=w83)
        call "Sound Output Start.gvi"(task ID in=w82, error in=w83) -> (task ID out=w84, error out=w85)
        call "Sound Output Write.gvi"(task ID in=w84, data=w80, error in=w85) -> (task ID out=w86, error out=w87)
        call "Sound Output Start.gvi"(task ID in=w86, error in=w87) -> (task ID out=w88, error out=w89)
        call "Sound Output Wait.gvi"(task ID in=w88, error in=w89, timeout=50) -> (task ID out=w90, error out=w91)
        call "Sound Output Stop.gvi"(task ID in=w90, error in=w91) -> (task ID out=w92, error out=w93)
        call "Sound Output Clear.gvi"(task ID=w92, error in=w93)
      }
    }
    case ($"HEAR PLUS PRO MAX +") {
      frame False, Default {
        Divide(x=w76, y=32768) -> w94
        Build Waveform Node(Y=w94) -> (output waveform=w95)
        Build Array(w95) -> w96
        w97 = "Sound Data Format.gtype" {"sample rate (S/s)"=22050, "number of channels"=1, "bits per sample"=16}
        call "Sound Output Configure.gvi"(device ID=0, sound format=w97, number of samples/ch=44100) -> (task ID=w98, error out=w99)
        call "Sound Output Start.gvi"(task ID in=w98, error in=w99) -> (task ID out=w100, error out=w101)
        call "Sound Output Write.gvi"(task ID in=w100, data=w96, error in=w101) -> (task ID out=w102, error out=w103)
        call "Sound Output Start.gvi"(task ID in=w102, error in=w103) -> (task ID out=w104, error out=w105)
        call "Sound Output Wait.gvi"(task ID in=w104, error in=w105, timeout=50) -> (task ID out=w106, error out=w107)
        call "Sound Output Stop.gvi"(task ID in=w106, error in=w107) -> (task ID out=w108, error out=w109)
        call "Sound Output Clear.gvi"(task ID=w108, error in=w109)
      }
      frame True { }
    }
    Tick Count() -> (timer value=w110)
    $"millisecond timer value" <- w110
    stop if FALSE
  }
  $"actual IQ rate" <- w4
  $"actual carrier frequency" <- w5
  # Binary to decimal conversion
  # Binary to decimal conversion
  call "niUSRP Abort.gvi"(Handle in=w20, error in (no error)=w22) -> (Handle out=w111, Error Out=w112)
  call "niUSRP Close Session.gvi"(handle in=w111, error in=w112) -> (error out=w113)
  call "Simple Error Handler.gvi"(error in=w113)
  $"actual gain (dB)" <- w6
